# Grasshopper definition Hops.gh (Grasshopper 1.0.7)
# plug-ins: Hops

circle = Circle(Plane=PlaneXY(0, 0, 0), Radius=1)
hops = Hops(
    Curve=circle,
    T=Slider(0, range=0..10),
    CacheResultsInMemory=True,
    CacheSolveResults=True,
    RemoteDefinitionLocation="http://127.0.0.1:5000/pointat",
    RemoteSolveVersion=(0, 1, 0))
panel = Panel(hops)
