# Grasshopper definition AIA-GeoOpt-Session-4_Jonathan Hernandez.gh (Grasshopper 1.0.7)
# plug-ins: Hops, Kangaroo2 Components, LunchBox

mobius_surface = MobiusSurface(
    UDivisions=100,
    VDivisions=Slider(2, range=0..10),
    RParameter=4,
    TParameter=Slider(3, range=0..10),
    Scale=5,
    Domain1=Domain(-3.141592654, 3.141592654),
    Domain2=Domain(-1, 1))
triremesh = TriRemesh(Geometry=mobius_surface, Iterations=25)  # -> Triangulation, Dual, Creases
mesh_edges = MeshEdges(Mesh=triremesh.Triangulation)  # -> NakedEdges, InteriorEdges, NonManifoldEdges
deconstruct_mesh = DeconstructMesh(Mesh=triremesh.Triangulation)  # -> Vertices, Faces, Colours, Normals
pt = Point(Point(46.23606611, 33.24261212, 0))
pt_2 = Point(Point(-38.59756236, -20.94908372, 11.68385586))
list = ValueList({"edgeLength", "sameWeight"}, selected="edgeLength")
list_2 = ValueList({"vertexGraph", "faceGraph"}, selected="faceGraph")
list_3 = ValueList({"dijkstra": "dijkstra_path", "shortest": "shortest_path"}, selected="dijkstra")
ln = Line(StartPoint=pt, EndPoint=pt_2)
mesh = Mesh(triremesh.Triangulation)
panel = Panel("http://127.0.0.1:5000/MeshPathWalker")
bbox = BoundingBox(Content=mesh, Plane=PlaneXY(0, 0, 0))  # -> Box, Box_2
colour_rgb = ColourRGB(Alpha=255, Red=Slider(69, range=0..255), Green=Slider(195, range=0..255), Blue=Slider(194, range=0..255))
mesh_colours = MeshColours(Mesh=mesh, Colours=colour_rgb)
debrep = DeconstructBrep(Brep=bbox.Box)  # -> Faces, Edges, Vertices
number_slider = Slider(0.83, range=0..1)
number_slider_2 = Slider(0.54, range=0..1)
number_slider_3 = Slider(0.07, range=0..1)
number_slider_4 = Slider(0.38, range=0..1)
item = ListItem(List=debrep.Faces, Index=0, Wrap=True)  # -> Item, Item1, Item2
vec = VectorXYZ(XComponent=number_slider_2, YComponent=number_slider, ZComponent=0)  # -> Vector, Length
vec_2 = VectorXYZ(XComponent=number_slider_4, YComponent=number_slider_3, ZComponent=0)  # -> Vector, Length
evalsrf = EvaluateSurface(Surface=reparameterize(item.Item), Point=vec.Vector)  # -> Point, Normal, UDirection, VDirection, Frame
evalsrf_2 = EvaluateSurface(Surface=reparameterize(item.Item2), Point=vec_2.Vector)  # -> Point, Normal, UDirection, VDirection, Frame
ln_2 = Line(StartPoint=evalsrf.Point, EndPoint=evalsrf_2.Point)
colour_rgb_2 = ColourRGB(Alpha=255, Red=0, Green=0, Blue=0)
hops = Hops(
    Mesh=mesh,
    WeightMode=list,
    GraphType=list_2,
    SLine=ln_2,
    Mode=list_3,
    CacheResultsInMemory=True,
    CacheSolveResults=True,
    RemoteDefinitionLocation="http://127.0.0.1:5000/MeshPathWalker",
    RemoteSolveVersion=(0, 1, 0))  # -> ShortestPath, FacesIndex
python = GhPythonScript(m=mesh)  # -> out, a; inputs m: Mesh
# ---------- python: Python ----------
import Rhino.Geometry as rg

mL = []

for f in range(m.Faces.Count):
    tempM = m.Duplicate()
    mL.append(tempM.Faces.ExtractFaces([f]))
    
a = mL
# ---------- end python ----------
dot = DotDisplay(Point=hops.ShortestPath)
galapagos = Galapagos(fitness=area, gene=[number_slider, number_slider_2, number_slider_3, number_slider_4])
item_2 = ListItem(List=python.a, Index=hops.FacesIndex, Wrap=True)
mjoin = MeshJoin(Meshes=item_2)
area = Area(Geometry=mjoin)  # -> Area, Centroid
colour_rgb_3 = ColourRGB(Alpha=255, Red=Slider(29, range=0..255), Green=Slider(142, range=0..255), Blue=Slider(153, range=0..255))
mesh_colours_2 = MeshColours(Mesh=mjoin, Colours=colour_rgb_3)
